# Grasshopper definition a2-square.gh (Grasshopper 1.0.7)

number_slider = Slider(5, range=0..50)
number_slider_2 = Slider(1.8, range=0..2)
number_slider_3 = Slider(22, range=0..50)
number = Number(1)
number_2 = Number(2)
number_3 = Number(-2)
division = Division(A=number_slider_3, B=number_2)
subtraction = Subtraction(A=number_slider, B=number)
division_2 = Division(A=number_slider_3, B=number_3)
division_3 = Division(A=number_slider_2, B=number_3)
subtraction_2 = Subtraction(A=division, B=subtraction)
rectangle = Rectangle(Plane=PlaneXY(0, 0, 0), XSize=number_slider_3, YSize=number_slider_3, Radius=Slider(2, range=0..50))  # -> Rectangle, Length
rectangle_2 = Rectangle(Plane=PlaneXY(0, 0, 0), XSize=number_slider_2, YSize=number_slider, Radius=0)  # -> Rectangle, Length
vector_xyz = VectorXYZ(XComponent=division_3, YComponent=subtraction_2, ZComponent=0)  # -> Vector, Length
vector_xyz_2 = VectorXYZ(XComponent=division_2, YComponent=division_2, ZComponent=0)  # -> Vector, Length
move = Move(Geometry=rectangle.Rectangle, Motion=vector_xyz_2.Vector)  # -> Geometry, Transform
move_2 = Move(Geometry=rectangle_2.Rectangle, Motion=vector_xyz.Vector)  # -> Geometry, Transform
polar_array = PolarArray(Geometry=move_2.Geometry, Plane=PlaneXY(0, 0, 0), Count=Slider(4, range=0..50), Angle=6.283185307)  # -> Geometry, Transform
trim_with_regions = TrimWithRegions(Curve=move.Geometry, Regions=polar_array.Geometry)  # -> Inside, Outside
trim_with_regions_2 = TrimWithRegions(Curve=polar_array.Geometry, Regions=move.Geometry)  # -> flatten(Inside), Outside
join_curves = JoinCurves(Curves=[trim_with_regions_2.Inside, trim_with_regions.Outside], Preserve=False)
panel = Panel(join_curves)
