# Grasshopper definition a2-triangle.gh (Grasshopper 1.0.7)

number_slider = Slider(1.8, range=0..10)
number = Number(-2)
number_2 = Number(3)
number_3 = Number(4)
division = Division(A=number_slider, B=number)
rectangle = Rectangle(Plane=PlaneXY(0, 0, 0), XSize=Slider(5, range=0..10), YSize=number_slider, Radius=0)  # -> Rectangle, Length
vector_xyz = VectorXYZ(XComponent=Slider(-10, range=-30..30), YComponent=division, ZComponent=0)  # -> Vector, Length
move = Move(Geometry=rectangle.Rectangle, Motion=vector_xyz.Vector)  # -> Geometry, Transform
polygon = Polygon(Plane=PlaneXY(0, 0, 0), Radius=Slider(18, range=0..30), Segments=number_2, FilletRadius=number_3)  # -> Polygon, Length
polar_array = PolarArray(Geometry=move.Geometry, Plane=PlaneXY(0, 0, 0), Count=number_2, Angle=6.283185307)  # -> Geometry, Transform
trim_with_regions = TrimWithRegions(Curve=polar_array.Geometry, Regions=polygon.Polygon)  # -> flatten(Inside), Outside
trim_with_regions_2 = TrimWithRegions(Curve=polygon.Polygon, Regions=polar_array.Geometry)  # -> Inside, Outside
join_curves = JoinCurves(Curves=[trim_with_regions_2.Outside, trim_with_regions.Inside], Preserve=False)
