# Grasshopper definition petal.gh (Grasshopper 1.0.7)

number_slider = Slider(66, range=0..1000)
number_slider_2 = Slider(55, range=0..100)
number_slider_3 = Slider(90, range=0..1000)
number_slider_4 = Slider(20, range=0..100)
number_slider_5 = Slider(60, range=0..100)
number = Number(-2)
subtraction = Subtraction(A=Slider(0, range=0..100), B=number_slider)
division = Division(A=number_slider_5, B=number)
vector_xyz = VectorXYZ(XComponent=0, YComponent=number_slider_2, ZComponent=0)  # -> Vector, Length
vector_xyz_2 = VectorXYZ(XComponent=subtraction, YComponent=number_slider_2, ZComponent=0)  # -> Vector, Length
circle = Circle(Plane=PlaneXY(0, 0, 0), Radius=Slider(24, range=0..100))
circle_2 = Circle(Plane=PlaneXY(0, 0, 0), Radius=number_slider_3)
vector_xyz_3 = VectorXYZ(XComponent=number_slider, YComponent=number_slider_2, ZComponent=0)  # -> Vector, Length
circle_3 = Circle(Plane=PlaneXY(0, 0, 0), Radius=number_slider_3)
circle_4 = Circle(Plane=PlaneXY(0, 0, 0), Radius=Slider(10.12, range=0..100))
rectangle = Rectangle(Plane=PlaneXY(0, 0, 0), XSize=number_slider_4, YSize=Slider(5, range=0..10), Radius=0)  # -> Rectangle, Length
number_2 = Number(-2)
move = Move(Geometry=circle, Motion=vector_xyz.Vector)  # -> Geometry, Transform
division_2 = Division(A=number_slider_4, B=number_2)
number_3 = Number(-0.7)
move_2 = Move(Geometry=circle_3, Motion=vector_xyz_3.Vector)  # -> Geometry, Transform
move_3 = Move(Geometry=circle_2, Motion=vector_xyz_2.Vector)  # -> Geometry, Transform
vector_xyz_4 = VectorXYZ(XComponent=division, YComponent=0, ZComponent=0)  # -> Vector, Length
rectangle_2 = Rectangle(Plane=PlaneXY(0, 0, 0), XSize=number_slider_5, YSize=Slider(55, range=0..100), Radius=0)  # -> Rectangle, Length
vector_xyz_5 = VectorXYZ(XComponent=division_2, YComponent=number_3, ZComponent=0)  # -> Vector, Length
vector_xyz_6 = VectorXYZ(XComponent=0, YComponent=Slider(10, range=0..10), ZComponent=0)  # -> Vector, Length
circle_5 = Circle(Plane=PlaneXY(0, 0, 0), Radius=Slider(4.75, range=0..10))
trim_with_regions = TrimWithRegions(Curve=move_2.Geometry, Regions=move_3.Geometry)  # -> Inside, Outside
move_4 = Move(Geometry=rectangle_2.Rectangle, Motion=vector_xyz_4.Vector)  # -> Geometry, Transform
trim_with_regions_2 = TrimWithRegions(Curve=move_3.Geometry, Regions=move_2.Geometry)  # -> Inside, Outside
move_5 = Move(Geometry=rectangle.Rectangle, Motion=vector_xyz_5.Vector)  # -> Geometry, Transform
move_6 = Move(Geometry=circle_4, Motion=vector_xyz_6.Vector)  # -> Geometry, Transform
trim_with_regions_3 = TrimWithRegions(Curve=move.Geometry, Regions=move_4.Geometry)  # -> Inside, Outside
trim_with_regions_4 = TrimWithRegions(Curve=move_6.Geometry, Regions=move_5.Geometry)  # -> flatten(Inside), Outside
join_curves = JoinCurves(Curves=[trim_with_regions_2.Inside, trim_with_regions.Inside], Preserve=False)
vector_xyz_7 = VectorXYZ(XComponent=0, YComponent=Slider(10, range=0..10), ZComponent=0)  # -> Vector, Length
trim_with_regions_5 = TrimWithRegions(Curve=join_curves, Regions=move_4.Geometry)  # -> Inside, Outside
trim_with_regions_6 = TrimWithRegions(Curve=trim_with_regions_5.Inside, Regions=move_5.Geometry)  # -> Inside, flatten(Outside)
vector_xyz_8 = VectorXYZ(XComponent=0, YComponent=Slider(60, range=0..100), ZComponent=0)  # -> Vector, Length
circle_6 = Circle(Plane=PlaneXY(0, 0, 0), Radius=Slider(9.8, range=0..100))
move_7 = Move(Geometry=circle_5, Motion=vector_xyz_7.Vector)  # -> Geometry, Transform
move_8 = Move(Geometry=circle_6, Motion=vector_xyz_8.Vector)  # -> Geometry, Transform
number_slider_6 = Slider(3, range=0..10)
number_4 = Number(2)
number_5 = Number(-2)
division_3 = Division(A=number_slider_6, B=number_4)
vector_xyz_9 = VectorXYZ(XComponent=0, YComponent=Slider(15.8, range=0..100), ZComponent=0)  # -> Vector, Length
circle_7 = Circle(Plane=PlaneXY(0, 0, 0), Radius=division_3)
rectangle_3 = Rectangle(Plane=PlaneXY(0, 0, 0), XSize=number_slider_6, YSize=Slider(1.5, range=0..10), Radius=0)  # -> Rectangle, Length
division_4 = Division(A=number_slider_6, B=number_5)
vector_xyz_10 = VectorXYZ(XComponent=division_4, YComponent=Slider(14.3, range=0..100), ZComponent=0)  # -> Vector, Length
move_9 = Move(Geometry=circle_7, Motion=vector_xyz_9.Vector)  # -> Geometry, Transform
move_10 = Move(Geometry=rectangle_3.Rectangle, Motion=vector_xyz_10.Vector)  # -> Geometry, Transform
trim_with_regions_7 = TrimWithRegions(Curve=move_10.Geometry, Regions=move_9.Geometry)  # -> Inside, Outside
trim_with_regions_8 = TrimWithRegions(Curve=move_9.Geometry, Regions=move_10.Geometry)  # -> Inside, Outside
join_curves_2 = JoinCurves(Curves=[trim_with_regions_8.Outside, trim_with_regions_7.Outside], Preserve=False)
trim_with_regions_9 = TrimWithRegions(Curve=move_7.Geometry, Regions=join_curves_2)  # -> Inside, Outside
trim_with_regions_10 = TrimWithRegions(Curve=join_curves_2, Regions=move_7.Geometry)  # -> Inside, Outside
join_curves_3 = JoinCurves(Curves=[trim_with_regions_9.Outside, trim_with_regions_10.Outside], Preserve=False)
join_curves_4 = JoinCurves(
    Curves=[trim_with_regions_4.Inside, trim_with_regions_3.Outside, trim_with_regions_6.Outside, move_8.Geometry, join_curves_3],
    Preserve=False)
